# Grasshopper definition module_01_parameter_input.gh (Grasshopper 1.0.7)

python = GhPythonScript()  # -> A, B
# ---------- python: Python ----------
A = True 
B = 'hello'
# ---------- end python ----------
panel = Panel(python.A)
panel_2 = Panel(python.B)
section_position = Slider(140, range=0..280)
section_position_2 = Slider(140, range=0..280)
width = Slider(90, range=50..150)
trim = Slider(-3, range=-20..20)
width_2 = Slider(90, range=50..150)
trim_2 = Slider(1, range=0..20)
length = Slider(280, range=100..400)
height = Slider(10, range=10..40)
offset = Slider(-2, range=-40..40)
length_2 = Slider(280, range=100..400)
height_2 = Slider(10, range=10..40)
offset_2 = Slider(-2, range=-40..40)
python_2 = GhPythonScript(length=length, width=width, height=height, section_position=section_position, offset=offset, trim=trim)  # -> B
# ---------- python_2: Python ----------
class SoleParameters(object):

    def __init__(self, length, width, height,
                 section_position, offset=0, trim=0):

        self.length = length
        self.width = width
        self.height = height
        self.section_position = section_position
        self.offset = offset
        self.trim = trim

    def validate(self):

        errors = []

        if self.length <= 0:
            errors.append("Length phai > 0")

        if self.width <= 0:
            errors.append("Width phai > 0")

        if self.height <= 0:
            errors.append("Height phai > 0")

        if not (0 <= self.section_position <= self.length):
            errors.append("Section Position phai nam trong Length")

        if self.trim < 0:
            errors.append("Trim khong duoc am")

        if abs(self.offset) >= self.width / 2:
            errors.append("Offset qua lon")

        if len(errors) == 0:
            return True, errors
        else:
            return False, errors


params = SoleParameters(length, width, height, section_position, offset, trim)
valid, errors = params.validate()

# Gop tat ca vao 1 list duy nhat, khong dung A nua
report = []
report.append("VALID: " + str(valid))
report.extend(errors)

B = report
# ---------- end python_2 ----------
python_3 = GhPythonScript(length=length_2, width=width_2, height=height_2, section_position=section_position_2, offset=offset_2, trim=trim_2)  # -> B; same code as python_2
panel_3 = Panel(python_2)
panel_4 = Panel(python_3)
