# Grasshopper definition module_02_base_geometry.gh (Grasshopper 1.0.7)

width = Slider(90, range=50..150)
height = Slider(10, range=10..40)
length = Slider(280, range=100..400)
python = GhPythonScript(length=length, width=width, height=height)  # -> R, X
# ---------- python: Python ----------
import Rhino.Geometry as rg

class BaseGeometry(object):

    def __init__(self, length, width, height):
        self.length = length
        self.width = width
        self.height = height

    def generate(self):

        plane = rg.Plane.WorldXY

        rect = rg.Rectangle3d(
            plane,
            rg.Interval(0, self.length),
            rg.Interval(-self.width / 2.0, self.width / 2.0)
        )

        box = rg.Box(
            plane,
            rg.Interval(0, self.length),
            rg.Interval(-self.width / 2.0, self.width / 2.0),
            rg.Interval(0, self.height)
        )

        return rect, box


geo = BaseGeometry(length, width, height)

rect, box = geo.generate()

R = rect
X = box
# ---------- end python ----------
