# Grasshopper definition module_03_section_generation.gh (Grasshopper 1.0.7)

num_sections = Slider(6, range=2..20)
width = Slider(90, range=50..150)
height = Slider(30, range=10..40)
length = Slider(280, range=100..400)
python = GhPythonScript(length=length, width=width, height=height, num_sections=num_sections)  # -> a
# ---------- python: Python ----------
import Rhino.Geometry as rg
import math

sections = []
n = int(num_sections)

for i in range(n):
    t = float(i) / (n - 1)
    x = t * length
    w = width * (0.5 + 0.5 * math.sin(math.pi * t))

    pts = [
        rg.Point3d(x, -w/2, 0),
        rg.Point3d(x,  w/2, 0),
        rg.Point3d(x,  w/2, height),
        rg.Point3d(x, -w/2, height),
        rg.Point3d(x, -w/2, 0)
    ]

    sections.append(rg.Polyline(pts).ToNurbsCurve())

a = sections
# ---------- end python ----------
