# Grasshopper definition module_05_offset_trim.gh (Grasshopper 1.0.7)

width = Slider(150, range=50..150)
height = Slider(40, range=10..40)
length = Slider(400, range=100..400)
num_sections = Slider(11, range=2..20)
python = GhPythonScript(length=length, width=width, height=height, num_sections=num_sections)  # -> S
# ---------- python: Python ----------
import Rhino.Geometry as rg
import math

sections = []
n = int(num_sections)

for i in range(n):
    t = float(i) / (n - 1)
    x = t * length
    w = width * (0.5 + 0.5 * math.sin(math.pi * t))

    pts = [
        rg.Point3d(x, -w/2, 0),
        rg.Point3d(x,  w/2, 0),
        rg.Point3d(x,  w/2, height),
        rg.Point3d(x, -w/2, height),
        rg.Point3d(x, -w/2, 0)
    ]

    sections.append(rg.Polyline(pts).ToNurbsCurve())

S = sections
# ---------- end python ----------
trim = Slider(-1, range=-20..20.001)
offset = Slider(-40, range=-40..40)
python_2 = GhPythonScript(sections=python)  # -> L; inputs sections: list of Curve
# ---------- python_2: Python ----------
import Rhino.Geometry as rg
loft = rg.Brep.CreateFromLoft(
    sections, rg.Point3d.Unset, rg.Point3d.Unset, rg.LoftType.Normal, False
)

L = loft[0] if loft else None
# ---------- end python_2 ----------
python_3 = GhPythonScript(offset=offset, trim=trim, brep=python_2)  # -> T; inputs brep: Brep
# ---------- python_3: Python ----------
import Rhino.Geometry as rg
import scriptcontext as sc
tol = sc.doc.ModelAbsoluteTolerance
bbox = brep.GetBoundingBox(True)
cut_start = rg.Plane(rg.Point3d(bbox.Min.X + trim, 0, 0), rg.Vector3d(-1, 0, 0))
cut_end = rg.Plane(rg.Point3d(bbox.Max.X - trim, 0, 0), rg.Vector3d(1, 0, 0))
result = brep
if trim > 0:
    for plane in (cut_start, cut_end):
        parts = result.Trim(plane, tol) if result else None
        result = parts[0] if parts else None
if result and offset != 0:
    off = rg.Brep.CreateOffsetBrep(result, offset, False, True, tol)
    result = off[0][0] if off[0] else None
T = result
# ---------- end python_3 ----------
