# Grasshopper definition practice_gh.gh (Grasshopper 1.0.7)

number_slider = Slider(12, range=0..100)
number_slider_2 = Slider(52, range=1..100)
Z = UnitZ(Factor=1)
int = Integer(15)
rev = Reverse(Vector=Z)
divide = DivideCurve(Curve=<geometry referenced from the Rhino model>, Count=Slider(16, range=1..100), Kinks=False)  # -> Points, Tangents, Parameters
divide_2 = DivideCurve(Curve=<geometry referenced from the Rhino model>, Count=number_slider, Kinks=False)  # -> Points, Tangents, Parameters
divide_3 = DivideCurve(Curve=<geometry referenced from the Rhino model>, Count=number_slider, Kinks=False)  # -> Points, Tangents, Parameters
Z_2 = UnitZ(Factor=1)
divide_4 = DivideCurve(Curve=<geometry referenced from the Rhino model>, Count=int, Kinks=False)  # -> Points, Tangents, Parameters
divide_5 = DivideCurve(Curve=<geometry referenced from the Rhino model>, Count=number_slider_2, Kinks=False)  # -> Points, Tangents, Parameters
divide_6 = DivideCurve(Curve=<geometry referenced from the Rhino model>, Count=number_slider_2, Kinks=False)  # -> Points, Tangents, Parameters
ln = Line(StartPoint=Point(-32.70091133, 48.08814019, 0), EndPoint=Point(147.4364182, 64.381969, 0))
divide_7 = DivideCurve(Curve=<geometry referenced from the Rhino model>, Count=int, Kinks=False)  # -> Points, Tangents, Parameters
pull = PullPoint(Point=divide.Points, Geometry=<curve referenced from the Rhino model>, ClosestOnly=True)  # -> ClosestPoint, Distance
pull_2 = PullPoint(Point=divide.Points, Geometry=<curve referenced from the Rhino model>, ClosestOnly=True)  # -> ClosestPoint, Distance
biarc = BiArc(StartPoint=divide_3.Points, StartTangent=Z_2, EndPoint=divide_2.Points, EndTangent=rev, Ratio=Slider(0.517, range=0..1))  # -> FirstArc, SecondArc, BiArc
ln_2 = Line(StartPoint=divide_7.Points, EndPoint=divide_4.Points)
ln_3 = Line(StartPoint=divide_6.Points, EndPoint=divide_5.Points)
arc = Arc3Pt(PointA=pull.ClosestPoint, PointB=divide.Points, PointC=pull_2.ClosestPoint)  # -> Arc, Plane, Radius
loft = Loft(Curves=biarc.FirstArc, Options={Adjust=False, Closed=False, LoftEnds=0, LoftSimp=0, LoftType=0, Rebuild=10, Refit=0.01})
loft_2 = Loft(Curves=biarc.SecondArc, Options={Adjust=False, Closed=False, LoftEnds=0, LoftSimp=0, LoftType=0, Rebuild=10, Refit=0.01})
join = BrepJoin(Breps=[loft_2, loft])  # -> Breps, Closed
